# Grasshopper definition a2.gh (Grasshopper 1.0.7)

# ---- group: Input parameters
width_of_slots = Slider(2.5, range=0..16)
# Center of the polygon
polygon_radius = Slider(20, range=5..30)
polygon_sides = Slider(6, range=3..16)
depth_of_slots = Slider(5, range=1..5)
point = Point(Point(1.64806805e-06, 7.080853819e-06, 0))

# ----
# Add 1 to the depth to extend the rectangle outside of the polygon
# in order to have the overlap to trim the slots
constant_add_1 = Slider(1, range=0..1)
polygon = Polygon(Plane=point, Radius=polygon_radius, Segments=polygon_sides, FilletRadius=0)  # -> Polygon, Length
addition = Addition(A=depth_of_slots, B=constant_add_1)
# Deconstruct the polygon
# since we need its edges
deconstruct_brep = DeconstructBrep(Brep=polygon.Polygon)  # -> Faces, Edges, Vertices
# Length of the polygon edge
length = Length(Curve=deconstruct_brep.Edges)
# Each edge is a curve and we need its
# midpoint to put a rectangle there as our slots
curve_middle = CurveMiddle(Curve=deconstruct_brep.Edges)
curve = Curve(deconstruct_brep.Edges)
panel = Panel(length)
division = Division(A=width_of_slots, B=length)
scale = Scale(Geometry=curve, Center=curve_middle, Factor=division)  # -> Geometry, Transform
boolean_toggle = BooleanToggle(True)
length_2 = Length(Curve=scale.Geometry)
vector_2pt = Vector2Pt(PointA=curve_middle, PointB=point, Unitize=boolean_toggle)  # -> Vector, Length
curve_2 = Curve(polygon.Polygon)
# Scale the geometry (the polygon edge)
# from the center (midpoint of edge)
# by the factor (width of slots divided by length of the polygon edge)
# So the length = width of slots (from the input area)
panel_2 = Panel(length_2)
amplitude = Amplitude(Vector=vector_2pt.Vector, Amplitude=addition)
# Set the length of the vector = depth of slots + 1
# Move from the direction of center point of polygon -> midpoint of each polygon edge
vector_2pt_2 = Vector2Pt(PointA=point, PointB=curve_middle, Unitize=boolean_toggle)  # -> Vector, Length
# Extrude the geometry (a curve with its length set to width of the slots)
# to the direction of midpoint of polygon edge -> center point of the polygon
extrude = Extrude(Base=scale.Geometry, Direction=amplitude)
# Move the geometry (rectangle)
# to the direction of the motion
# Since we've unitized it, we are moving it by one unit
move = Move(Geometry=extrude, Motion=vector_2pt_2.Vector)  # -> Geometry, Transform

# ---- group: Final steps - Trim & Join
trim_with_regions = TrimWithRegions(Curve=curve_2, Regions=move.Geometry)  # -> Inside, Outside
trim_with_regions_2 = TrimWithRegions(Curve=move.Geometry, Regions=curve_2)  # -> Inside, Outside
curve_3 = Curve(flatten(trim_with_regions_2.Inside))
curve_4 = Curve(flatten(trim_with_regions.Outside))
curve_5 = Curve(trim_with_regions.Inside)
curve_6 = Curve(trim_with_regions_2.Outside)
join_curves = JoinCurves(Curves=[curve_4, curve_3], Preserve=False)
